# Dynamo graph Hafta13-Kolon-Mark.dyn (Dynamo 3.4.1.7055)

string = StringInput("Structural Columns")
byName = Category.ByName(name=string)
all_elements_of_category = ElementsOfCategory(Category=byName)
string_2 = StringInput("Mark")
string_3 = StringInput("K-")
code_block = CodeBlock { 1; }
count = List.Count(list=all_elements_of_category)
code_block_2 = CodeBlock { 1; }
sequence = Sequence(start=code_block, amount=count, step=code_block_2)
string_from_object = FromObject(object=sequence)
add = string_3 + string_from_object
setParameterByName = Element.SetParameterByName(element=all_elements_of_category, parameterName=string_2, value=add)
